# Dynamo graph PackingSolarCell.dyn "solarcal" (Dynamo 2.19.3.6394)
# packages: DynamoUnfold 1.0.1

# group: Solar Declination
number_slider = DoubleSlider(172, range=1..365 step 1)
code_block = CodeBlock(x=number_slider) { (360/365)*(x-81); }
sin = Math.Sin(angle=code_block)
code_block_2 = CodeBlock(x=sin) { 23.45*x; }

latitude = CodeBlock { 13.7563; }

# group: Solar Panel
panel_tilt_angle = DoubleSlider(15, range=1..90 step 1)  # graph input
panel_pan_angle = DoubleSlider(180, range=0..360 step 1)

# group: Angle of Incidence > 1
sin_2 = Math.Sin(angle=code_block_2)
sin_3 = Math.Sin(angle=latitude)
cos = Math.Cos(angle=panel_tilt_angle)
code_block_3 = CodeBlock(a=sin_2, b=sin_3, c=cos) { a*b*c; }

# group: Angle of Incidence > 2
sin_4 = Math.Sin(angle=code_block_2)
cos_2 = Math.Cos(angle=latitude)
sin_5 = Math.Sin(angle=panel_tilt_angle)
cos_3 = Math.Cos(angle=panel_pan_angle)
code_block_4 = CodeBlock(a=sin_4, b=cos_2, c=sin_5, d=cos_3) { a*b*c*d; }

# group: Hour Angle
number_slider_2 = DoubleSlider(7, range=6..12 step 1)
code_block_5 = CodeBlock(t=number_slider_2) { 15*(t-12); }

# group: Angle of Incidence > 3
cos_4 = Math.Cos(angle=code_block_2)
cos_5 = Math.Cos(angle=latitude)
cos_6 = Math.Cos(angle=code_block_5)
cos_7 = Math.Cos(angle=panel_tilt_angle)
code_block_6 = CodeBlock(a=cos_4, b=cos_5, c=cos_6, d=cos_7) { a*b*c*d; }

# group: Angle of Incidence > 4
cos_8 = Math.Cos(angle=code_block_2)
sin_6 = Math.Sin(angle=latitude)
cos_9 = Math.Cos(angle=code_block_5)
sin_7 = Math.Sin(angle=panel_tilt_angle)
cos_10 = Math.Cos(angle=panel_pan_angle)
code_block_7 = CodeBlock(a=cos_8, b=sin_6, c=cos_9, d=sin_7, e=cos_10) { a*b*c*d*e; }

# group: Angle of Incidence > 5
cos_11 = Math.Cos(angle=code_block_2)
sin_8 = Math.Sin(angle=code_block_5)
sin_9 = Math.Sin(angle=panel_tilt_angle)
sin_10 = Math.Sin(angle=panel_pan_angle)
code_block_8 = CodeBlock(a=cos_11, b=sin_8, c=sin_9, d=sin_10) { a*b*c*d; }

# group: Angle of Incidence
code_block_9 = CodeBlock(a=code_block_3, b=code_block_4, c=code_block_6, d=code_block_7, e=code_block_8) { a+b+c-d-e; }
asin = Math.Asin(ratio=code_block_9)
installation_efficiency = Watch(code_block_9)  # graph output

code_block_10 = CodeBlock { 10; }
byLengths = Cuboid.ByLengths(width=code_block_10, length=code_block_10, height=code_block_10)
faces = Topology.Faces(topology=byLengths)
surfaceGeometry = Face.SurfaceGeometry(face=faces)
number_slider_3 = DoubleSlider(0, range=0..5 step 1)
getItemAtIndex = List.GetItemAtIndex(list=surfaceGeometry, index=number_slider_3)
normalAtParameter = Surface.NormalAtParameter(surface=getItemAtIndex)
watch = Watch(normalAtParameter)
unfoldListOfFaces = DynamoUnfold.Unfolding.UnfoldListOfFaces(faces=faces)
flatten = List.Flatten(list=unfoldListOfFaces@L1)
getItemAtIndex_2 = List.GetItemAtIndex(list=flatten, index=number_slider_3)
watch_2 = Watch(getItemAtIndex_2)
code_block_11 = CodeBlock { 1; }
number_slider_4 = DoubleSlider(0.5, range=0..1 step 0.01)
getIsoline = Surface.GetIsoline(surface=watch_2, isoDirection=code_block_11, parameter=number_slider_4)
watch_3 = Watch(getIsoline)
startPoint = Curve.StartPoint(curve=watch_3)
X = Point.X(point=startPoint)
watch_4 = Watch(X)
endPoint = Curve.EndPoint(curve=watch_3)
X_2 = Point.X(point=endPoint)
watch_5 = Watch(X_2)
Y = Point.Y(point=startPoint)
watch_6 = Watch(Y)
Y_2 = Point.Y(point=endPoint)
watch_7 = Watch(Y_2)
code_block_12 = CodeBlock(A=watch_4, B=watch_5, C=watch_6, D=watch_7) { (A-B)+(C-D); }
abs = Math.Abs(number=code_block_12)
watch_8 = Watch(abs)
area = Surface.Area(surface=surfaceGeometry)
watch_9 = Watch(area)
watch_3d = Watch3D(getItemAtIndex)
watch_3d_2 = Watch3D(unfoldListOfFaces)
code_block_13 = CodeBlock { 0; }
number_slider_5 = DoubleSlider(0.5, range=0..1 step 0.01)
getIsoline_2 = Surface.GetIsoline(surface=watch_2, isoDirection=code_block_13, parameter=number_slider_5)
watch_10 = Watch(getIsoline_2)
startPoint_2 = Curve.StartPoint(curve=watch_10)
X_3 = Point.X(point=startPoint_2)
watch_11 = Watch(X_3)
endPoint_2 = Curve.EndPoint(curve=watch_10)
X_4 = Point.X(point=endPoint_2)
watch_12 = Watch(X_4)
Y_3 = Point.Y(point=startPoint_2)
watch_13 = Watch(Y_3)
Y_4 = Point.Y(point=endPoint_2)
watch_14 = Watch(Y_4)
code_block_14 = CodeBlock(A=watch_11, B=watch_12, C=watch_13, D=watch_14) { (A-B)+(C-D); }
abs_2 = Math.Abs(number=code_block_14)
watch_15 = Watch(abs_2)
code_block_15 = CodeBlock { 0.5; }
pointAtParameter = Surface.PointAtParameter(surface=watch_2, u=code_block_15, v=code_block_15)

# group: PV size
length = CodeBlock { 1; }
width = CodeBlock { 0.5; }

# group: the Solar Elevation Angle (α)
sin_11 = Math.Sin(angle=latitude)
sin_12 = Math.Sin(angle=code_block_2)
cos_12 = Math.Cos(angle=latitude)
cos_13 = Math.Cos(angle=latitude)
cos_14 = Math.Cos(angle=code_block_5)
code_block_16 = CodeBlock(a=sin_11, b=sin_12, c=cos_12, d=cos_13, e=cos_14) { (a*b)+(c*d*e); }
sin_13 = Math.Sin(angle=code_block_16)

# group: the Solar Azimuth Angle (𝛾)
cos_15 = Math.Cos(angle=code_block_2)
sin_14 = Math.Sin(angle=code_block_5)
cos_16 = Math.Cos(angle=sin_13)
code_block_17 = CodeBlock(a=cos_15, b=sin_14, c=cos_16) { (a*b)/c; }
asin_2 = Math.Asin(ratio=code_block_17)

# group: Solar Altitude Angle
sin_15 = Math.Sin(angle=code_block_2)
sin_16 = Math.Sin(angle=latitude)
cos_17 = Math.Cos(angle=latitude)
cos_18 = Math.Cos(angle=code_block_2)
cos_19 = Math.Cos(angle=code_block_5)
code_block_18 = CodeBlock(a=sin_15, b=sin_16, c=cos_17, d=cos_18, e=cos_19) { (a*b)+(c*d*e); }
asin_3 = Math.Asin(ratio=code_block_18)

# group: Distance between PV row & colume
spacing_between_pv_row = CodeBlock(a=width) { a+0.05; }
cos_20 = Math.Cos(angle=panel_tilt_angle)
sin_17 = Math.Sin(angle=panel_tilt_angle)
code_block_19 = CodeBlock(a=asin_2) { 180+a; }
code_block_20 = CodeBlock(a=code_block_19) { a-180; }
cos_21 = Math.Cos(angle=code_block_20)
tan = Math.Tan(angle=asin_3)
spacing_between_pv_modules = CodeBlock(length=length, a=sin_17, b=cos_21, c=tan) { ((length*a)*b)/c; }
abs_3 = Math.Abs(number=spacing_between_pv_modules)
spacing_between_pv_colume = CodeBlock(length=length, cos=cos_20, S=abs_3) { (length*cos)+S; }
spacing_between_pv_modules_2 = Watch(abs_3)  # graph output

# group: PV
X_5 = Point.X(point=pointAtParameter)
code_block_21 = CodeBlock(x=X_5) { x+0.25; }
Y_5 = Point.Y(point=pointAtParameter)
cos_22 = Math.Cos(angle=panel_tilt_angle)
code_block_22 = CodeBlock(Len=length, cos=cos_22) { Len*cos; }
code_block_23 = CodeBlock(y=Y_5, L=code_block_22) { y+(L/2); }
byOrigin = CoordinateSystem.ByOrigin(x=code_block_21, y=code_block_23)
byWidthLength = Rectangle.ByWidthLength(coordinateSystem=byOrigin, width=width, length=code_block_22)
code_block_24 = CodeBlock(X=spacing_between_pv_row, Y=spacing_between_pv_colume) { 5; -5..5..X; -5..5..Y; }
translate = Geometry.Translate(geometry=byWidthLength, xTranslation=code_block_24.out1, yTranslation=code_block_24.out2, zTranslation=code_block_24.out0, lacing=CrossProduct)
byCoordinates = Point.ByCoordinates(x=X_5, y=Y_5)
byOriginNormal = Plane.ByOriginNormal(origin=byCoordinates)
rotate = Geometry.Rotate(geometry=translate, basePlane=byOriginNormal, degrees=panel_pan_angle)

code_block_25 = CodeBlock { -1; }
byCoordinates_2 = Vector.ByCoordinates(z=code_block_25)
projectInputOnto = Surface.ProjectInputOnto(surface=watch_2, geometryToProject=rotate, projectionDirection=byCoordinates_2, lacing=CrossProduct)
flatten_2 = List.Flatten(list=projectInputOnto@L2)
watch_16 = Watch(flatten_2)
startPoint_3 = Curve.StartPoint(curve=watch_16)
byCornerPoints = Rectangle.ByCornerPoints(points=startPoint_3)
byPatch = Surface.ByPatch(closedCurve=byCornerPoints)
area_2 = Surface.Area(surface=byPatch)
code_block_26 = CodeBlock(W=width, L=code_block_22) { W*L; }
eq = area_2 == code_block_26
code_block_27 = CodeBlock(n=eq) { n == true; }
filterByBoolMask = List.FilterByBoolMask(list=byPatch, mask=code_block_27)
area_3 = Surface.Area(surface=filterByBoolMask.in)
sum = Math.Sum(values=area_3)
area_of_pv = Watch(sum)
number_of_pv = CodeBlock(a=area_of_pv, b=code_block_26) { a/b; }
number_of_pv_2 = Watch(number_of_pv)
code_block_28 = CodeBlock(a=number_of_pv_2, b=width, c=length) { a*(b*c); }
area_of_pv_2 = Watch(code_block_28)  # graph output
area_4 = Surface.Area(surface=watch_2)
code_block_29 = CodeBlock(x=area_of_pv_2, y=area_4) { x*100/y; }
area_ration_of_instal_area_and = Watch(code_block_29)  # "area ration of instal area and PV area"
flatten_3 = List.Flatten(list=area_2)
code_block_30 = CodeBlock { 0; }
clean = List.Clean(list=flatten_3, preserveIndices=code_block_30)
sum_2 = Math.Sum(values=clean)
watch_17 = Watch(sum_2)

# group: Calculate Energy
code_block_31 = CodeBlock(a=asin_3) { 90-a; }
cos_23 = Math.Cos(angle=code_block_31)
dni_kw_m_2 = CodeBlock(a=cos_23) { 1.361*a; }
efficiency = CodeBlock { 0.2; }
solar_efficiency = CodeBlock { 0.75; }
code_block_32 = CodeBlock(a=dni_kw_m_2, b=area_of_pv_2, c=code_block_9, d=efficiency, e=solar_efficiency) { a*b*c*d*e; }
energy_kw = Watch(code_block_32)

# group: Output
energy_kwh = Watch(energy_kw)
distance_pv = Watch(spacing_between_pv_modules_2)
area_of_pv_3 = Watch(area_of_pv_2)
angle_of_incidence = Watch(installation_efficiency)

ม_มตกกระทบ = Watch(installation_efficiency)
ม_มเงย = Watch(asin_3)
ระยะห_าง = Watch(spacing_between_pv_modules_2)
watch_18 = Watch(cos_23)
